# Dynamo graph InsertIntoSqlite.dyn (Dynamo 1.3.0.875)

file_path = Filename("..\..\..\..\..\..\Dev Lab\SeaDUG\Sandbox\SQLite Example\DB\Mechanical.db")
boolean = BoolSelector(true)
table_name = StringInput("MechDucts")
string = StringInput("ElementId")
string_2 = StringInput("Height")
string_3 = StringInput("Width")
column_name = StringInput("Length")
list_of_fields_in_db = List.Create(string, string_2, string_3, column_name)
select_model_element = DSModelElementSelection()  # 1 picked in the model
id = Element.Id(select_model_element)
string_from_object = FromObject(id)
getParameterValueByName = Element.GetParameterValueByName(element=select_model_element, parameterName=string_2)
string_from_object_2 = FromObject(getParameterValueByName)
getParameterValueByName_2 = Element.GetParameterValueByName(element=select_model_element, parameterName=string_3)
string_from_object_3 = FromObject(getParameterValueByName_2)
getParameterValueByName_3 = Element.GetParameterValueByName(element=select_model_element, parameterName=column_name)
string_from_object_4 = FromObject(getParameterValueByName_3)
list_of_field_values_in_db = List.Create(string_from_object, string_from_object_2, string_from_object_3, string_from_object_4)
python_script = Python(IN[0]=table_name, IN[1]=list_of_fields_in_db, IN[2]=list_of_field_values_in_db)  # unwired: IN[3]
# ---------- python_script.python (15 lines) ----------
import clr
clr.AddReference('ProtoGeometry')
from Autodesk.DesignScript.Geometry import *
#The inputs to this node will be stored as a list in the IN variables.
tableName = IN[0]
listOfFields = IN[1]
listOfValues = IN[2]
#listOfElements = IN[3]

fieldsAsString = ", ".join(listOfFields)
valuesAsString = ", ".join(listOfValues)
#elementsAsString = ", ".join(listOfElements)

#Assign your output to the OUT variable.
OUT = "INSERT INTO " + tableName + " (" + fieldsAsString + ") " + "VALUES " + "(" +  valuesAsString + ");"
# ----------------------------------------
SQLite_Command = Database.Command.SQLite_Command(file_path, boolean, python_script)
watch = Watch(python_script)
categories = Categories("DuctCurves")
all_elements_of_category = ElementsOfCategory(categories)
id_2 = Element.Id(all_elements_of_category)
string_from_object_5 = FromObject(id_2)
python_script_2 = Python(IN[0]=table_name, IN[1]=list_of_fields_in_db, IN[2]=list_of_field_values_in_db, IN[3]=string_from_object_5)
# ---------- python_script_2.python (25 lines) ----------
import clr
clr.AddReference('ProtoGeometry')
from Autodesk.DesignScript.Geometry import *
#The inputs to this node will be stored as a list in the IN variables.
tableName = IN[0]
listOfFields = IN[1]
listOfValues = IN[2]
listOfElements = IN[3]

#myDic = {"elements": listOfValues[0]}
#myDic = dict( (name,eval(name)) for name in listOfElements )

#Create a dictionary with element id as key
myDic={listOfValues[0]:[]}
myDic[listOfValues[0]].extend([a for a in listOfValues])

#testOne = myDic[1049412]

# String type casting
fieldsAsString = ", ".join(listOfFields)
valuesAsString = ", ".join(listOfValues)
elementsAsString = ", ".join(listOfElements)

#Assign your output to the OUT variable.
OUT = str(myDic)
# ----------------------------------------
watch_2 = Watch(python_script_2)
